# Grasshopper definition gh_file.gh (Grasshopper 1.0.8)
# plug-ins: RhinoCodePluginGH

panel = Panel("/Users/avery_tsai/OrbStack/docker/volumes/walker_arm/src/walker_arm/hiwin_description")
merge = Merge(
    Data1=Slider(56, range=-170..170),
    Data2=Slider(7, range=-150..95),
    Data3=Slider(-43, range=-85..185),
    Data4=Slider(-75, range=-190..190),
    Data5=Slider(-43, range=-135..135),
    Data6=Slider(47, range=-360..360))
panel_2 = Panel("/Users/avery_tsai/OrbStack/docker/volumes/walker_arm/src/walker_arm/hiwin_description/urdf/rebar_arm.urdf")
py3 = Python3Script(DirPath=panel, Reload=Button())  # -> out, Meshes, Paths; inputs DirPath: String, Reload: Boolean
# ---------- py3: Python ----------
# ========== 電池01：載入網格 ==========
# 輸入：DirPath (str), Reload (bool)
# 輸出：Meshes, Paths

import sys
sys.path.append(r"/Users/avery_tsai/project/hiwin_prc")
from robot import mesh_loader

# 載入網格（自動遞迴搜尋 .stl 檔案）
Meshes, Paths = mesh_loader.load(
    DirPath if 'DirPath' in globals() and DirPath else r"/Users/avery_tsai/project/hiwin_prc/urdf/walker_arm",
    Reload if 'Reload' in globals() else False
)

a = Meshes
# ---------- end py3 ----------
mesh = Mesh([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])
py3_2 = Python3Script(URDFPath=panel_2, Meshes=py3.Meshes, MeshPaths=py3.Paths, J=merge, Deg=Toggle(True), Reload=Button())  # -> out, G, a, Names, JointOrder; inputs URDFPath: String, Meshes: list of Mesh, MeshPaths: list of String, J: list of Double, Deg: Boolean, Reload: Boolean
# ---------- py3_2: Python ----------
# ========== 電池02：URDF 運動學 ==========
# 輸入：URDFPath (str), Meshes (list), MeshPaths (list), J (list), Deg (bool), Reload (bool)
# 輸出：G, Names, JointOrder

import sys
sys.path.append(r"/Users/avery_tsai/project/hiwin_prc")
from robot import urdf_loader

# 載入 URDF 並計算運動學
G, Names, JointOrder = urdf_loader.load(
    URDFPath if 'URDFPath' in globals() and URDFPath else r"/Users/avery_tsai/project/hiwin_prc/urdf/walker_arm/urdf/walker_arm.urdf",
    Meshes if 'Meshes' in globals() else [],
    MeshPaths if 'MeshPaths' in globals() else [],
    J if 'J' in globals() and J else [0, 0, 0, 0, 0, 0],
    Deg if 'Deg' in globals() else True,
    Reload if 'Reload' in globals() else False
)

a = G
# ---------- end py3_2 ----------
scale = Scale(Geometry=py3_2.G, Center=Point(0, 0, 0), Factor=Slider(1000, range=0..1000))  # -> Geometry, Transform
panel_3 = Panel(py3_2.G)
