# Grasshopper definition urdf_loader.gh (Grasshopper 1.0.8)
# plug-ins: RhinoCodePluginGH

panel = Panel("/Users/avery/project/hiwin_prc/config/output.jsonl")
py3 = Python3Script(Path=panel, Reload=Button())  # -> out, Data, Text, JOSNL; inputs Path: String, Reload: Boolean
# ---------- py3: Python ----------
# ========== Trajectory Loader (python01) ==========
# Inputs:
#   Path   (str)  - JSON file path (default: /Users/avery_tsai/project/hiwin_prc/config/output.json)
#   Reload (bool) - Force reload, clear cache (default: False)
# Outputs:
#   Data  (any)  - Raw JSON content (dict/list)
#   Text  (str)  - Raw JSON string (optional)
#   JSONL (str) - Converted JSONL text (one JSON row per line)
#   Lines (list) - JSONL lines as list of strings
#   OutPath (str) - Where JSONL was (would be) written on disk
#   Count (int) - Number of frames/lines parsed

#
# Notes:
# - Designed for Grasshopper GhPython. Paste the file content into a GhPython component
#   or use execfile() / import techniques as you prefer.

import os
import json

try:
    import scriptcontext as sc
except ImportError:
    sc = None

CACHE_KEY = 'GH_TRAJ_CACHE'


def _get_cache():
    if sc is None:
        return {}
    if not hasattr(sc, 'sticky'):
        return {}
    cache = sc.sticky.get(CACHE_KEY)
    if cache is None:
        cache = {}
        sc.sticky[CACHE_KEY] = cache
    return cache


def _read_json_obj(path):
    # Prefer UTF-8; fall back to UTF-8-sig if BOM exists
    try:
        with open(path, 'r', encoding='utf-8') as f:
            return json.load(f)
    except ValueError:
        with open(path, 'r', encoding='utf-8-sig') as f:
            return json.load(f)


def _read_text(path):
    # Read as text for debugging/inspection
    try:
        with open(path, 'r', encoding='utf-8') as f:
            return f.read()
    except Exception:
        with open(path, 'r', encoding='utf-8-sig', errors='ignore') as f:
            return f.read()

# ===== Helpers for JSON -> JSONL (joint1..joint6) =====

def _normalize_name(name):
    try:
        return str(name).strip().lower().replace('_', '')
    except Exception:
        return ''


def _pick_value_by_name(names, positions, j_index):
    target = 'joint{}'.format(j_index)
    try:
        norm = [_normalize_name(n) for n in (names or [])]
        for i, n in enumerate(norm):
            if n == target:
                return float(positions[i]) if i < len(positions or []) else 0.0
    except Exception:
        pass
    # fallback by index (1-based)
    if isinstance(positions, (list, tuple)) and len(positions) >= j_index:
        return float(positions[j_index - 1])
    return 0.0


def _ensure_six(values):
    vals = list(values[:6]) if isinstance(values, (list, tuple)) else []
    if len(vals) < 6:
        vals += [0.0] * (6 - len(vals))
    return vals


def _parse_frames_any(obj):
    # Shape C: {"joint_names": [...], "points": [ {"positions": [...]}, ... ]}
    if isinstance(obj, dict) and isinstance(obj.get('points'), list):
        names = obj.get('joint_names') or obj.get('names') or []
        if not isinstance(names, (list, tuple)):
            names = []
        frames = []
        for pt in obj['points']:
            if not isinstance(pt, dict):
                continue
            positions = pt.get('positions') or pt.get('position') or []
            if not isinstance(positions, (list, tuple)):
                positions = []
            jvals = [
                _pick_value_by_name(names, positions, 1),
                _pick_value_by_name(names, positions, 2),
                _pick_value_by_name(names, positions, 3),
                _pick_value_by_name(names, positions, 4),
                _pick_value_by_name(names, positions, 5),
                _pick_value_by_name(names, positions, 6),
            ]
            jvals = _ensure_six(jvals)
            frames.append({
                'joint1': jvals[0],
                'joint2': jvals[1],
                'joint3': jvals[2],
                'joint4': jvals[3],
                'joint5': jvals[4],
                'joint6': jvals[5],
            })
        return frames

    # Shape A/B: joint_states list or plain list of entries
    seq = None
    if isinstance(obj, dict):
        if isinstance(obj.get('joint_states'), list):
            seq = obj['joint_states']
        else:
            # fallback: first list-like value
            for v in obj.values():
                if isinstance(v, list):
                    seq = v
                    break
    elif isinstance(obj, list):
        seq = obj

    if not isinstance(seq, list) or not seq:
        return []

    frames = []
    for entry in seq:
        if not isinstance(entry, dict):
            continue
        names = entry.get('name') or entry.get('names') or []
        positions = entry.get('position') or entry.get('positions') or []
        if not isinstance(names, (list, tuple)):
            names = []
        if not isinstance(positions, (list, tuple)):
            positions = []
        jvals = [
            _pick_value_by_name(names, positions, 1),
            _pick_value_by_name(names, positions, 2),
            _pick_value_by_name(names, positions, 3),
            _pick_value_by_name(names, positions, 4),
            _pick_value_by_name(names, positions, 5),
            _pick_value_by_name(names, positions, 6),
        ]
        jvals = _ensure_six(jvals)
        frames.append({
            'joint1': jvals[0],
            'joint2': jvals[1],
            'joint3': jvals[2],
            'joint4': jvals[3],
            'joint5': jvals[4],
            'joint6': jvals[5],
        })
    return frames


def _frames_to_jsonl_lines(frames):
    try:
        return [json.dumps(row, ensure_ascii=False) for row in frames]
    except Exception:
        return []


def _write_text_safe(path, text):
    try:
        with open(path, 'w') as f:
            f.write(text)
    except Exception:
        pass

        with open(path, 'r', encoding='utf-8') as f:
            return f.read()
    except Exception:
        with open(path, 'r', encoding='utf-8-sig', errors='ignore') as f:
            return f.read()


def _extract_stamp(entry):
    # Try common stamp fields: time, stamp, header.stamp
    t = entry.get('time')
    if isinstance(t, (int, float)):
        return float(t)

    stamp = entry.get('stamp') or entry.get('header', {}).get('stamp')
    if isinstance(stamp, dict):
        secs = stamp.get('secs') or stamp.get('sec') or stamp.get('seconds') or 0
        nsecs = stamp.get('nsecs') or stamp.get('nanosec') or stamp.get('nanosecs') or 0
        try:
            return float(secs) + float(nsecs) * 1e-9
        except Exception:
            return None
    return None


def _parse_joint_states(obj):
    # Accept two shapes:
    # 1) {"joint_states": [ {"name": [...], "position": [...], ...}, ... ]}
    # 2) [ {"name": [...], "position": [...], ...}, ... ]
    seq = None
    if isinstance(obj, dict):
        if 'joint_states' in obj and isinstance(obj['joint_states'], list):
            seq = obj['joint_states']
        else:
            # allow dict of frames keyed by something
            # fallback to values if they look like frames
            vals = list(obj.values())
            if vals and isinstance(vals[0], list):
                seq = vals[0]
    if seq is None and isinstance(obj, list):
        seq = obj
    if not isinstance(seq, list):
        return [], [], [], 0

    if not seq:
        return [], [], [], 0

    first = seq[0]
    names = list(first.get('name') or first.get('names') or [])
    if not names:
        # try common joint names default
        # if absent, attempt to infer from URDF typical pattern
        names = ['joint_1','joint_2','joint_3','joint_4','joint_5','joint_6']

    frames = []
    times = []

    for entry in seq:
        pos = entry.get('position') or entry.get('positions') or []
        if not pos or len(pos) < len(names):
            # pad/truncate to names length
            pos = (list(pos) + [0.0] * len(names))[:len(names)]
        frame = {names[i]: float(pos[i]) for i in range(len(names))}
        frames.append(frame)
        times.append(_extract_stamp(entry))

    return frames, names, times, len(frames)


# -------- Grasshopper entry point --------
try:
    default_path = r"/Users/avery_tsai/project/hiwin_prc/config/output.json"
    _path = Path if 'Path' in globals() and Path else default_path
    _reload = Reload if 'Reload' in globals() else False

    Data = None
    Text = ''
    JSONL = ''
    Lines = []
    OutPath = ''
    Count = 0

    if _path and os.path.exists(_path):
        cache = _get_cache()
        mtime = os.path.getmtime(_path)
        ext = os.path.splitext(_path)[1].lower()
        key = ('TRAJ_JSON_JSONL', os.path.abspath(_path), mtime, ext)

        if _reload and cache:
            cache.clear()

        if key in cache:
            Data, Text, JSONL, Lines, OutPath, Count = cache[key]
        else:
            abspath = os.path.abspath(_path)
            if ext == '.jsonl':
                Text = _read_text(_path)
                Lines = [ln for ln in Text.splitlines() if ln.strip()]
                JSONL = '\n'.join(Lines) + ('\n' if Lines else '')
                OutPath = abspath
                Count = len(Lines)
                Data = None
            else:
                # Treat as JSON and convert to JSONL
                Data = _read_json_obj(_path)
                Text = _read_text(_path)
                frames = _parse_frames_any(Data)
                Lines = _frames_to_jsonl_lines(frames)
                JSONL = '\n'.join(Lines) + ('\n' if Lines else '')
                Count = len(Lines)
                OutPath = os.path.splitext(abspath)[0] + '.jsonl'
                if JSONL:
                    _write_text_safe(OutPath, JSONL)
            cache[key] = (Data, Text, JSONL, Lines, OutPath, Count)

except Exception:
    Data, Text, JSONL, Lines, OutPath, Count = None, '', '', [], '', 0
# ---------- end py3 ----------
txt = Text()
py3_2 = Python3Script(Path=panel, S=Slider(1, range=0..1))  # -> out, J, Count, Line; inputs Lines: list of String, Path: String, S: Double
# ---------- py3_2: Python ----------
# ========== Trajectory JSONL Player (python02) ==========
# Inputs:
#   Lines (list[str]) - JSONL lines, each line like {"joint1": ..., ..., "joint6": ...}
#   JSONL (str)       - Raw JSONL text (fallback if Lines not provided)
#   Path  (str)       - Path to a .jsonl file (fallback if neither Lines nor JSONL provided)
#   S     (float)     - Normalized slider [0..1] to select line (preferred)
#   Index (int)       - Legacy index (0-based); used if S not provided
# Outputs:
#   J     (list[float]) - [joint1..joint6] for the selected line
#   Count (int)         - Number of lines
#   Line  (str)         - The selected raw JSONL line
#   I     (int)         - The selected 0-based index

import os
import json


def _read_text(path):
    try:
        with open(path, 'r', encoding='utf-8') as f:
            return f.read()
    except Exception:
        try:
            with open(path, 'r', encoding='utf-8-sig', errors='ignore') as f:
                return f.read()
        except Exception:
            return ''


def _build_lines():
    # Prefer Lines input if present
    lines_val = globals().get('Lines', None)
    if isinstance(lines_val, (list, tuple)):
        return [str(x) for x in lines_val if str(x).strip()]
    # Fallback to JSONL text
    jsonl_val = globals().get('JSONL', None)
    if isinstance(jsonl_val, str) and jsonl_val:
        return [ln for ln in jsonl_val.splitlines() if ln.strip()]
    # Fallback to Path to read file
    path_val = globals().get('Path', None)
    if path_val:
        text = _read_text(path_val)
        if text:
            return [ln for ln in text.splitlines() if ln.strip()]
    return []


def _to_index(count):
    if count <= 0:
        return 0
    s_val = globals().get('S', None)
    if s_val is None:
        s_val = globals().get('Phase', None)
    if s_val is not None:
        try:
            s = float(s_val)
        except Exception:
            s = 0.0
        if s < 0.0:
            s = 0.0
        if s > 1.0:
            s = 1.0
        return int(round(s * (count - 1))) if count > 1 else 0
    i_val = globals().get('Index', None)
    if i_val is not None:
        try:
            i = int(i_val)
        except Exception:
            i = 0
        if i < 0:
            i = 0
        if i >= count:
            i = count - 1
        return i
    return 0


def _parse_joints_from_line(line):
    # Expect dict with joint1..joint6; provide a fallback for position arrays
    try:
        obj = json.loads(line)
    except Exception:
        return [0.0, 0.0, 0.0, 0.0, 0.0, 0.0]

    if isinstance(obj, dict):
        # Primary: joint1..joint6
        keys = ['joint1','joint2','joint3','joint4','joint5','joint6']
        if all(k in obj for k in keys):
            try:
                vals = [float(obj.get(k, 0.0)) for k in keys]
                return (vals + [0.0] * 6)[:6]
            except Exception:
                pass
        # Fallback: positions/position list
        pos = obj.get('positions') or obj.get('position') or obj.get('J')
        if isinstance(pos, (list, tuple)):
            try:
                vals = [float(v) for v in pos]
                vals = (vals + [0.0] * 6)[:6]
                return vals
            except Exception:
                pass
    return [0.0, 0.0, 0.0, 0.0, 0.0, 0.0]


# -------- Grasshopper entry point --------
try:
    _lines = _build_lines()
    Count = len(_lines)

    if Count <= 0:
        J, Line, I = [], '', 0
    else:
        I = _to_index(Count)
        Line = _lines[I]
        J = _parse_joints_from_line(Line)

except Exception:
    J, Count, Line, I = [], 0, '', 0
# ---------- end py3_2 ----------
panel_2 = Panel("/Users/avery/OrbStack/docker/volumes/walker_arm/src/rs_pkg/pose_calibration/test.yaml")
panel_3 = Panel("/Users/avery/OrbStack/docker/volumes/walker_arm/src/rs_pkg/pose_calibration/workspace.yaml")
number_slider = Slider(1000, range=0..1000)
number_slider_2 = Slider(1000, range=0..1000)
panel_4 = Panel("/Users/avery/project/hiwin_prc/test_2.yaml")
button = Button()
button_2 = Button()
item = ListItem(List=py3_2.J, Index=0, Wrap=True)  # -> Item, Item1, Item2, Item3, Item4, Item5
py3_3 = Python3Script(Path=panel_3, Scale=number_slider_2, Reload=button_2)  # -> out, Planes, IDs; inputs Path: String, Scale: Double, Reload: Boolean
# ---------- py3_3: Python ----------
# -*- coding: utf-8 -*-
"""
Grasshopper Python Component - ArUco YAML Loader (Self-contained)

Inputs:
  Path   (str)  - YAML 檔案路徑 (預設: /Users/avery/project/hiwin_prc/test.yaml)
  Scale  (float) - 縮放係數，米轉毫米 (預設: 1000.0)
  Reload (bool) - 強制重新載入，清除快取 (預設: False)

Outputs:
  Planes (list) - ArUco marker 的 Rhino Plane 物件列表
  IDs    (list) - Marker ID 列表

特點：
- 完全自包含，無需安裝 PyYAML
- 自帶極簡 YAML 解析器，支援單行與多行的 position/orientation 寫法
- 使用 Grasshopper scriptcontext.sticky 進行快取
"""

from __future__ import print_function
import os
import math

try:
    import Rhino.Geometry as rg
except Exception:
    rg = None

try:
    import scriptcontext as sc
except Exception:
    sc = None

# ------------------------
# Quaternion / Geometry
# ------------------------

def _normalize_quaternion(qx, qy, qz, qw):
    n = math.sqrt(qx*qx + qy*qy + qz*qz + qw*qw)
    if n < 1e-9:
        return 0.0, 0.0, 0.0, 1.0
    return qx/n, qy/n, qz/n, qw/n


def quaternion_to_rotation_matrix(qx, qy, qz, qw):
    qx, qy, qz, qw = _normalize_quaternion(qx, qy, qz, qw)
    qx2, qy2, qz2 = qx*qx, qy*qy, qz*qz
    qxy, qxz, qyz = qx*qy, qx*qz, qy*qz
    qwx, qwy, qwz = qw*qx, qw*qy, qw*qz
    return [
        [1 - 2*(qy2 + qz2), 2*(qxy - qwz),     2*(qxz + qwy)],
        [2*(qxy + qwz),     1 - 2*(qx2 + qz2), 2*(qyz - qwx)],
        [2*(qxz - qwy),     2*(qyz + qwx),     1 - 2*(qx2 + qy2)]
    ]


def quaternion_to_euler(qx, qy, qz, qw):
    qx, qy, qz, qw = _normalize_quaternion(qx, qy, qz, qw)
    roll = math.atan2(2*(qw*qx + qy*qz), 1 - 2*(qx*qx + qy*qy))
    sinp = 2 * (qw*qy - qz*qx)
    pitch = math.copysign(math.pi/2, sinp) if abs(sinp) >= 1 else math.asin(sinp)
    yaw = math.atan2(2*(qw*qz + qx*qy), 1 - 2*(qy*qy + qz*qz))
    return math.degrees(roll), math.degrees(pitch), math.degrees(yaw)


def aruco_to_plane(marker, scale=1000.0):
    if rg is None:
        raise RuntimeError("Rhino.Geometry not available. Run inside Rhino/Grasshopper.")
    pos = marker['position']
    ori = marker['orientation']
    origin = rg.Point3d(pos['x']*scale, pos['y']*scale, pos['z']*scale)
    R = quaternion_to_rotation_matrix(ori['x'], ori['y'], ori['z'], ori['w'])
    x_axis = rg.Vector3d(R[0][0], R[1][0], R[2][0]); x_axis.Unitize()
    y_axis = rg.Vector3d(R[0][1], R[1][1], R[2][1]); y_axis.Unitize()
    return rg.Plane(origin, x_axis, y_axis)

# ------------------------
# Minimal YAML Loader
# ------------------------

def _parse_inline_mapping(line):
    # e.g. position: {x: 0.1, y: 0.2, z: 0.3}
    try:
        content = line[line.index('{')+1: line.rindex('}')]
    except ValueError:
        return {}
    result = {}
    for pair in content.split(','):
        if ':' not in pair:
            continue
        k, v = pair.split(':', 1)
        k = k.strip()
        v = v.strip()
        try:
            result[k] = float(v)
        except Exception:
            try:
                result[k] = float(v.replace(',', '.'))
            except Exception:
                result[k] = 0.0
    return result


def _parse_block_mapping(lines, start):
    # parse lines like: x: 0.1, y: 0.2 ... until a header or list start
    result = {}
    i = start
    while i < len(lines):
        s = lines[i].strip()
        if not s or s.startswith('#'):
            i += 1; continue
        if s.startswith(('-', 'position:', 'orientation:', 'pose:', 'frame:', 'workspace_corners:')):
            break
        if ':' in s:
            k, v = s.split(':', 1)
            k = k.strip(); v = v.strip()
            try:
                result[k] = float(v)
            except Exception:
                try:
                    result[k] = float(v.replace(',', '.'))
                except Exception:
                    result[k] = 0.0
        i += 1
    return result, i


def load_yaml_simple(yaml_text):
    data = {'frame': 'world', 'workspace_corners': []}
    lines = yaml_text.splitlines()
    i = 0
    current = None
    while i < len(lines):
        line = lines[i].strip()
        if not line or line.startswith('#'):
            i += 1; continue

        if line.startswith('frame:'):
            frame_val = line.split(':', 1)[1].strip().strip("\"'")
            if frame_val:
                data['frame'] = frame_val
            i += 1; continue

        if line.startswith('- id:'):
            # start a new marker
            try:
                marker_id = int(line.split(':', 1)[1].strip())
            except Exception:
                marker_id = -1
            current = {'id': marker_id, 'position': {'x':0.0,'y':0.0,'z':0.0},
                       'orientation': {'x':0.0,'y':0.0,'z':0.0,'w':1.0}}
            # scan ahead for pose/position/orientation
            j = i + 1
            while j < len(lines):
                l2 = lines[j].strip()
                if not l2 or l2.startswith('#'):
                    j += 1; continue
                if l2.startswith('- id:'):
                    break
                if l2.startswith('position:'):
                    if '{' in l2 and '}' in l2:
                        current['position'] = _parse_inline_mapping(l2)
                    else:
                        mapping, j2 = _parse_block_mapping(lines, j+1)
                        current['position'] = dict({'x':0.0,'y':0.0,'z':0.0}, **mapping)
                        j = j2 - 1
                elif l2.startswith('orientation:'):
                    if '{' in l2 and '}' in l2:
                        current['orientation'] = _parse_inline_mapping(l2)
                    else:
                        mapping, j2 = _parse_block_mapping(lines, j+1)
                        current['orientation'] = dict({'x':0.0,'y':0.0,'z':0.0,'w':1.0}, **mapping)
                        j = j2 - 1
                j += 1
            data['workspace_corners'].append({'id': current['id'], 'pose': {
                'position': current['position'], 'orientation': current['orientation']}})
            i = j
            continue
        i += 1
    return data


def parse_aruco_markers(data):
    corners = data.get('workspace_corners', [])
    markers = []
    for c in corners:
        m_id = c.get('id', -1)
        pose = c.get('pose', {})
        pos = pose.get('position', {})
        ori = pose.get('orientation', {})
        px = float(pos.get('x', 0.0)); py = float(pos.get('y', 0.0)); pz = float(pos.get('z', 0.0))
        ox = float(ori.get('x', 0.0)); oy = float(ori.get('y', 0.0)); oz = float(ori.get('z', 0.0)); ow = float(ori.get('w', 1.0))
        roll, pitch, yaw = quaternion_to_euler(ox, oy, oz, ow)
        markers.append({
            'id': m_id,
            'position': {'x': px, 'y': py, 'z': pz},
            'orientation': {'x': ox, 'y': oy, 'z': oz, 'w': ow},
            'euler_angles': {'roll': roll, 'pitch': pitch, 'yaw': yaw}
        })
    return markers

# ------------------------
# Cache Helpers
# ------------------------

_FALLBACK_CACHE = {}


def _get_cache_dict():
    if sc and hasattr(sc, 'sticky'):
        if 'GH_ARUCO_COMPONENT_CACHE' not in sc.sticky:
            sc.sticky['GH_ARUCO_COMPONENT_CACHE'] = {}
        return sc.sticky['GH_ARUCO_COMPONENT_CACHE']
    return _FALLBACK_CACHE

# ------------------------
# Main (Grasshopper I/O)
# ------------------------

# Defaults for GH inputs if not provided
DEFAULT_PATH = r"/Users/avery/OrbStack/docker/volumes/walker_arm/src/rs_pkg/pose_calibration/test.yaml"
try:
    yaml_path = Path if 'Path' in globals() and Path else DEFAULT_PATH
except Exception:
    yaml_path = DEFAULT_PATH
try:
    scale = Scale if 'Scale' in globals() and Scale is not None else 1000.0
except Exception:
    scale = 1000.0
try:
    reload_cache = bool(Reload) if 'Reload' in globals() else False
except Exception:
    reload_cache = False

# Initialize outputs
Planes = []
IDs = []

try:
    if not yaml_path or not os.path.exists(yaml_path):
        print("[ArUco] File not found:", yaml_path)
    else:
        cache = _get_cache_dict()
        key = ('ARUCO_PLANES', os.path.abspath(yaml_path), os.path.getmtime(yaml_path), float(scale))

        if reload_cache:
            cache.clear()

        if key in cache:
            Planes, IDs = cache[key]
        else:
            with open(yaml_path, 'r') as f:
                text = f.read()
            data = load_yaml_simple(text)
            markers = parse_aruco_markers(data)

            # Convert to Rhino planes
            if rg is None:
                raise RuntimeError('Rhino.Geometry not available')
            planes = []
            ids = []
            for m in markers:
                try:
                    planes.append(aruco_to_plane(m, scale))
                    ids.append(m['id'])
                except Exception as ex:
                    print("[ArUco] Skip marker", m.get('id'), "reason:", ex)
            Planes, IDs = planes, ids
            cache[key] = (Planes, IDs)

        print("[ArUco] Markers:", len(IDs))
except Exception as e:
    Planes = []
    IDs = []
    import traceback as _tb
    print("[ArUco] Error:", e)
    print(_tb.format_exc())
# ---------- end py3_3 ----------
py3_4 = Python3Script(Path=panel_2, Scale=number_slider_2, Reload=button_2)  # -> out, Planes, a; inputs Path: String, Scale: Double, Reload: Boolean; unedited script template
panel_5 = Panel(py3_3.Planes)
panel_6 = Panel(py3_4.Planes)
panel_7 = Panel(py3_3.IDs)
panel_8 = Panel("/Users/avery/OrbStack/docker/volumes/walker_arm/src/walker_arm/hiwin_description")
merge = Merge(
    Data1=Slider(90, range=-170..170),
    Data2=Slider(45, range=-150..95),
    Data3=Slider(-45, range=-85..185),
    Data4=Slider(0, range=-190..190),
    Data5=Slider(0, range=-135..135),
    Data6=Slider(0, range=-360..360))
sph = Sphere(Base=py3_3.Planes, Radius=Slider(33, range=0..100))
panel_9 = Panel("/Users/avery/OrbStack/docker/volumes/walker_arm/src/walker_arm/hiwin_description/urdf/new_gripper")
merge_2 = Merge(
    Data1=Slider(-88, range=-185..85),
    Data2=Slider(-79, range=-155..35),
    Data3=Slider(117, range=-130..154),
    Data4=Slider(87, range=-350..350),
    Data5=Slider(3, range=-130..130),
    Data6=Slider(61, range=-350..350))
py3_5 = Python3Script(DirPath=panel_8, Reload=Button())  # -> out, Meshes, Paths; inputs DirPath: String, Reload: Boolean
# ---------- py3_5: Python ----------
# ========== 電池01：載入網格 ==========
# 輸入：DirPath (str), Reload (bool)
# 輸出：Meshes, Paths

import sys
sys.path.append(r"/Users/avery/project/hiwin_prc")
from robot import mesh_loader

# 載入網格（自動遞迴搜尋 .stl 檔案）
Meshes, Paths = mesh_loader.load(
    DirPath if 'DirPath' in globals() and DirPath else r"/Users/avery_tsai/project/hiwin_prc/urdf/walker_arm",
    Reload if 'Reload' in globals() else False
)

a = Meshes
# ---------- end py3_5 ----------
panel_10 = Panel("/Users/avery_tsai/project/robosim/urdf/kuka_kr300_support/urdf/kr300r2500ultra.urdf")
py3_6 = Python3Script(DirPath="/Users/avery_tsai/project/robosim/urdf/kuka_kr300_support", Reload=Button())  # -> out, Meshes, Paths; inputs DirPath: String, Reload: Boolean
# ---------- py3_6: Python ----------
# ========== 電池01：載入網格 ==========
# 輸入：DirPath (str), Reload (bool)
# 輸出：Meshes, Paths

import sys
sys.path.append(r"/Users/avery_tsai/project/hiwin_prc")
from robot import mesh_loader

# 載入網格（自動遞迴搜尋 .stl 檔案）
Meshes, Paths = mesh_loader.load(
    DirPath if 'DirPath' in globals() and DirPath else r"/Users/avery_tsai/project/hiwin_prc/urdf/walker_arm",
    Reload if 'Reload' in globals() else False
)

a = Meshes
# ---------- end py3_6 ----------
py3_7 = Python3Script(URDFPath=panel_9, Meshes=py3_5.Meshes, MeshPaths=py3_5.Paths, J=merge, Deg=Toggle(True), Reload=Button())  # -> out, G, a, Names, JointOrder; inputs URDFPath: String, Meshes: list of Mesh, MeshPaths: list of String, J: list of Double, Deg: Boolean, Reload: Boolean
# ---------- py3_7: Python ----------
# ========== 電池02：URDF 運動學 ==========
# 輸入：URDFPath (str), Meshes (list), MeshPaths (list), J (list), Deg (bool), Reload (bool)
# 輸出：G, Names, JointOrder

import sys
sys.path.append(r"/Users/avery/project/hiwin_prc")
from robot import urdf_loader

# 載入 URDF 並計算運動學
G, Names, JointOrder = urdf_loader.load(
    URDFPath if 'URDFPath' in globals() and URDFPath else r"/Users/avery_tsai/project/hiwin_prc/urdf/walker_arm/urdf/walker_arm.urdf",
    Meshes if 'Meshes' in globals() else [],
    MeshPaths if 'MeshPaths' in globals() else [],
    J if 'J' in globals() and J else [0, 0, 0, 0, 0, 0],
    Deg if 'Deg' in globals() else True,
    Reload if 'Reload' in globals() else False
)

a = G
# ---------- end py3_7 ----------
panel_11 = Panel(py3_5.Meshes)
py3_8 = Python3Script(URDFPath=panel_10, Meshes=py3_6.Meshes, MeshPaths=py3_6.Paths, J=merge_2, Deg=Toggle(True), Reload=Button())  # -> out, G, a, Names, JointOrder; inputs URDFPath: String, Meshes: list of Mesh, MeshPaths: list of String, J: list of Double, Deg: Boolean, Reload: Boolean
# ---------- py3_8: Python ----------
# ========== 電池02：URDF 運動學 ==========
# 輸入：URDFPath (str), Meshes (list), MeshPaths (list), J (list), Deg (bool), Reload (bool)
# 輸出：G, Names, JointOrder

import sys
sys.path.append(r"/Users/avery_tsai/project/hiwin_prc")
from robot import urdf_loader

# 載入 URDF 並計算運動學
G, Names, JointOrder = urdf_loader.load(
    URDFPath if 'URDFPath' in globals() and URDFPath else r"/Users/avery_tsai/project/hiwin_prc/urdf/walker_arm/urdf/walker_arm.urdf",
    Meshes if 'Meshes' in globals() else [],
    MeshPaths if 'MeshPaths' in globals() else [],
    J if 'J' in globals() and J else [0, 0, 0, 0, 0, 0],
    Deg if 'Deg' in globals() else True,
    Reload if 'Reload' in globals() else False
)

a = G
# ---------- end py3_8 ----------
scale = Scale(Center=Point(0, 0, 0), Factor=Slider(1000, range=0..1000))  # -> Geometry, Transform
scale_2 = Scale(Geometry=py3_7.G, Center=Point(0, 0, 0), Factor=Slider(1000, range=0..1000))  # -> Geometry, Transform
panel_12 = Panel(py3_8.G)
panel_13 = Panel(py3_7.JointOrder)
