# Grasshopper definition motion_command.gh (Grasshopper 1.0.8)
# plug-ins: RhinoCodePluginGH

number_slider = Slider(0, range=0..100)
series = Series(Start=0, Step=Slider(22, range=0..100), Count=10)
xy = XYPlane(Origin=Point(0, 0, 0))
Z = UnitZ(Factor=series)
merge = Merge(
    Data1=number_slider,
    Data2=number_slider,
    Data3=number_slider,
    Data4=number_slider,
    Data5=number_slider,
    Data6=number_slider)
move = Move(Geometry=xy, Motion=Z)  # -> Geometry, Transform
movej = Python3Script(plane=move.Geometry)  # -> movej_command; inputs plane: Plane
# ---------- movej: Python ----------
import math
import json
from collections import OrderedDict

try:
    import Rhino.Geometry as rg
except Exception:
    rg = None


def _compute_rpy_from_axes(x_axis, y_axis, z_axis):
    """Compute roll, pitch, yaw (deg) from right-handed axes using ZYX convention.

    R = Rz(yaw) * Ry(pitch) * Rx(roll)
    Columns of rotation matrix are the axis unit vectors in world coordinates.
    """
    r11 = x_axis.X
    r12 = y_axis.X
    r13 = z_axis.X
    r21 = x_axis.Y
    r22 = y_axis.Y
    r23 = z_axis.Y
    r31 = x_axis.Z
    r32 = y_axis.Z
    r33 = z_axis.Z

    sy = math.sqrt(r11 * r11 + r21 * r21)
    singular = sy < 1e-9

    if not singular:
        yaw = math.degrees(math.atan2(r21, r11))
        pitch = math.degrees(math.atan2(-r31, sy))
        roll = math.degrees(math.atan2(r32, r33))
    else:
        # Gimbal lock
        yaw = math.degrees(math.atan2(-r12, r22))
        pitch = math.degrees(math.atan2(-r31, sy))
        roll = 0.0

    return roll, pitch, yaw


def _build_axes_from_z(z_axis):
    """Given a Z axis (Vector3d), build a stable right-handed frame (X, Y, Z).

    Uses world X as reference; if nearly parallel, switches to world Y.
    X = Z x refX; Y = Z x X.
    """
    z = rg.Vector3d(z_axis)
    if not z.Unitize():
        raise ValueError("Z axis vector cannot be zero-length")

    ref_x = rg.Vector3d(1.0, 0.0, 0.0)
    if abs(rg.Vector3d.Multiply(z, ref_x)) > 0.99:  # nearly parallel
        ref_x = rg.Vector3d(0.0, 1.0, 0.0)

    x = rg.Vector3d.CrossProduct(z, ref_x)
    _ = x.Unitize()
    y = rg.Vector3d.CrossProduct(z, x)
    _ = y.Unitize()

    return x, y, z


def plane_to_movej(plane):
    """Convert a Rhino Plane to moveJ dict with meters and ZYX Euler angles (deg).

    - Position: mm -> m
    - Orientation: use Plane.XAxis/YAxis/ZAxis directly (deconstruct plane), then RPY (deg)
    - motion_type is always "moveJ"
    """
    if rg is None:
        raise RuntimeError("Rhino.Geometry not available. This script is intended for Rhino/Grasshopper.")

    origin = plane.Origin
    x_m = origin.X / 1000.0
    y_m = origin.Y / 1000.0
    z_m = origin.Z / 1000.0

    # Deconstruct Plane: use plane's axes to preserve its rotation
    x_axis = rg.Vector3d(plane.XAxis); x_axis.Unitize()
    y_axis = rg.Vector3d(plane.YAxis); y_axis.Unitize()
    z_axis = rg.Vector3d(plane.ZAxis); z_axis.Unitize()
    roll_deg, pitch_deg, yaw_deg = _compute_rpy_from_axes(x_axis, y_axis, z_axis)

    result = OrderedDict([
        ("motion_type", "moveJ"),
        ("x", round(x_m, 3)),
        ("y", round(y_m, 3)),
        ("z", round(z_m, 3)),
        ("roll", round(roll_deg, 3)),
        ("pitch", round(pitch_deg, 3)),
        ("yaw", round(yaw_deg, 3)),
    ])
    return result


# Grasshopper convenience: if a variable named `plane` exists in the scope,
# compute outputs `result` and `movej_command` for direct wiring.
try:  # noqa: SIM105
    plane  # type: ignore[name-defined]
    if plane is not None and rg is not None:
        result = plane_to_movej(plane)  # type: ignore[name-defined]
        movej_command = json.dumps(result, sort_keys=False)
except NameError:
    pass
# ---------- end movej ----------
movel = Python3Script(plane=move.Geometry)  # -> movel_command; inputs plane: Plane
# ---------- movel: Python ----------
import math
import json
from collections import OrderedDict

try:
    import Rhino.Geometry as rg
except Exception:
    rg = None


def _compute_rpy_from_axes(x_axis, y_axis, z_axis):
    """Compute roll, pitch, yaw (deg) from right-handed axes using ZYX convention.

    R = Rz(yaw) * Ry(pitch) * Rx(roll)
    Columns of rotation matrix are the axis unit vectors in world coordinates.
    """
    r11 = x_axis.X
    r12 = y_axis.X
    r13 = z_axis.X
    r21 = x_axis.Y
    r22 = y_axis.Y
    r23 = z_axis.Y
    r31 = x_axis.Z
    r32 = y_axis.Z
    r33 = z_axis.Z

    sy = math.sqrt(r11 * r11 + r21 * r21)
    singular = sy < 1e-9

    if not singular:
        yaw = math.degrees(math.atan2(r21, r11))
        pitch = math.degrees(math.atan2(-r31, sy))
        roll = math.degrees(math.atan2(r32, r33))
    else:
        # Gimbal lock
        yaw = math.degrees(math.atan2(-r12, r22))
        pitch = math.degrees(math.atan2(-r31, sy))
        roll = 0.0

    return roll, pitch, yaw


def _build_axes_from_z(z_axis):
    """Given a Z axis (Vector3d), build a stable right-handed frame (X, Y, Z).

    Uses world X as reference; if nearly parallel, switches to world Y.
    X = Z x refX; Y = Z x X.
    """
    z = rg.Vector3d(z_axis)
    if not z.Unitize():
        raise ValueError("Z axis vector cannot be zero-length")

    ref_x = rg.Vector3d(1.0, 0.0, 0.0)
    if abs(rg.Vector3d.Multiply(z, ref_x)) > 0.99:  # nearly parallel
        ref_x = rg.Vector3d(0.0, 1.0, 0.0)

    x = rg.Vector3d.CrossProduct(z, ref_x)
    _ = x.Unitize()
    y = rg.Vector3d.CrossProduct(z, x)
    _ = y.Unitize()

    return x, y, z


def plane_to_movel(plane):
    """Convert a Rhino Plane to moveL dict with meters and ZYX Euler angles (deg).

    - Position: mm -> m
    - Orientation: use Plane.XAxis/YAxis/ZAxis directly (deconstruct plane), then RPY (deg)
    - motion_type is always "moveL"
    """
    if rg is None:
        raise RuntimeError("Rhino.Geometry not available. This script is intended for Rhino/Grasshopper.")

    origin = plane.Origin
    x_m = origin.X / 1000.0
    y_m = origin.Y / 1000.0
    z_m = origin.Z / 1000.0

    # Deconstruct Plane: use plane's axes to preserve its rotation
    x_axis = rg.Vector3d(plane.XAxis); x_axis.Unitize()
    y_axis = rg.Vector3d(plane.YAxis); y_axis.Unitize()
    z_axis = rg.Vector3d(plane.ZAxis); z_axis.Unitize()
    roll_deg, pitch_deg, yaw_deg = _compute_rpy_from_axes(x_axis, y_axis, z_axis)

    result = OrderedDict([
        ("motion_type", "moveL"),
        ("x", round(x_m, 3)),
        ("y", round(y_m, 3)),
        ("z", round(z_m, 3)),
        ("roll", round(roll_deg, 3)),
        ("pitch", round(pitch_deg, 3)),
        ("yaw", round(yaw_deg, 3)),
    ])
    return result


# Grasshopper convenience: if a variable named `plane` exists in the scope,
# compute outputs `result` and `movel_command` for direct wiring.
try:  # noqa: SIM105
    plane  # type: ignore[name-defined]
    if plane is not None and rg is not None:
        result = plane_to_movel(plane)  # type: ignore[name-defined]
        movel_command = json.dumps(result, sort_keys=False)
except NameError:
    pass


# O(-500.00,1000.00,50.00) Z(0.00,0.00,1.00) 這是 grasshopper 中輸入的 plane。
# 請幫我將 @moveL_movement.py.py  中，透過 rhino/grasshopper 語法專換為歐拉角
# ---------- end movel ----------
axis = Python3Script(joints=merge)  # -> axis_command; inputs joints: list
# ---------- axis: Python ----------
import json

if 'joints' not in locals() or len(joints) != 6:
    raise ValueError("輸入的 'joints' 必須是一個包含 6 個數值的 list。")

axis_data = {
    "motion_type": "axis",
    "joint1": float(joints[0]),
    "joint2": float(joints[1]),
    "joint3": float(joints[2]),
    "joint4": float(joints[3]),
    "joint5": float(joints[4]),
    "joint6": float(joints[5])
}
# result 可輸出 dict 或 JSON 字串，依 GH 需求選擇
result = axis_data
# 若要輸出 JSON 字串，請取消註解下行
# result = json.dumps(axis_data, indent=4)
axis_command = json.dumps(axis_data)
# ---------- end axis ----------
merge_2 = Merge(Data1=movej, Data2=movel, Data3=axis)  # -> flatten(Result)
panel = Panel(axis)
merge_3 = Merge(
    Data1=Slider(0, range=-1..1),
    Data2=Slider(0, range=-1..1),
    Data3=Slider(0.01, range=-1..1),
    Data4=Slider(29, range=-180..180),
    Data5=Slider(-21, range=-180..180),
    Data6=Slider(50, range=-180..180))
py3 = Python3Script(ros_pose="[-0.0, 0.0, 0.05, 0, 0, 90]", pose=merge_3)  # -> out, plane; inputs pose: list
# ---------- py3: Python ----------
import math, json, ast

try:
    import Rhino.Geometry as rg
except ImportError:
    rg = None


def _rotation_matrix_from_rpy(roll_rad, pitch_rad, yaw_rad):
    """從 RPY 歐拉角計算旋轉矩陣 (ZYX 慣例)
    
    R = Rz(yaw) * Ry(pitch) * Rx(roll)
    
    Args:
        roll_rad: Roll 角度 (弧度)
        pitch_rad: Pitch 角度 (弧度)
        yaw_rad: Yaw 角度 (弧度)
    
    Returns:
        3x3 旋轉矩陣 (list of lists)
    """
    cr = math.cos(roll_rad)
    sr = math.sin(roll_rad)
    cp = math.cos(pitch_rad)
    sp = math.sin(pitch_rad)
    cy = math.cos(yaw_rad)
    sy = math.sin(yaw_rad)
    
    # R = Rz * Ry * Rx
    # 第一列
    r11 = cy * cp
    r12 = cy * sp * sr - sy * cr
    r13 = cy * sp * cr + sy * sr
    
    # 第二列
    r21 = sy * cp
    r22 = sy * sp * sr + cy * cr
    r23 = sy * sp * cr - cy * sr
    
    # 第三列
    r31 = -sp
    r32 = cp * sr
    r33 = cp * cr
    
    return [
        [r11, r12, r13],
        [r21, r22, r23],
        [r31, r32, r33]
    ]


def ros_to_plane(x_m, y_m, z_m, roll_deg, pitch_deg, yaw_deg):
    """將 ROS 座標轉換為 Rhino Plane（只回傳 Plane）

    Args:
        x_m: X 座標 (米)
        y_m: Y 座標 (米)
        z_m: Z 座標 (米)
        roll_deg: Roll 角度 (度)
        pitch_deg: Pitch 角度 (度)
        yaw_deg: Yaw 角度 (度)

    Returns:
        Rhino.Geometry.Plane 物件
    """
    if rg is None:
        raise RuntimeError("Rhino.Geometry not available. This script is intended for Rhino/Grasshopper.")

    # 位置轉換：米 -> 毫米
    x_mm = x_m * 1000.0
    y_mm = y_m * 1000.0
    z_mm = z_m * 1000.0
    origin = rg.Point3d(x_mm, y_mm, z_mm)

    # 角度轉換：度 -> 弧度
    roll_rad = math.radians(roll_deg)
    pitch_rad = math.radians(pitch_deg)
    yaw_rad = math.radians(yaw_deg)

    # 計算旋轉矩陣
    R = _rotation_matrix_from_rpy(roll_rad, pitch_rad, yaw_rad)

    # 從旋轉矩陣提取軸向量（列向量）
    x_axis = rg.Vector3d(R[0][0], R[1][0], R[2][0])
    y_axis = rg.Vector3d(R[0][1], R[1][1], R[2][1])
    # z 軸可由 x,y 推得，亦可直接使用矩陣第三列
    # 這裡仍計算並單位化，雖然不回傳
    z_axis = rg.Vector3d(R[0][2], R[1][2], R[2][2])
    x_axis.Unitize(); y_axis.Unitize(); z_axis.Unitize()

    # 建立 Plane 並只回傳 plane
    plane = rg.Plane(origin, x_axis, y_axis)
    return plane


# Grasshopper interface: two inputs
# - pose: list/tuple [x, y, z, roll, pitch, yaw] (meters, degrees)
# - ros_pose: string like "[-0.5, 1.0, 0.05, 0.0, 0.0, 90.0]" (Panel), or list; takes priority over pose when both provided

def _is_str(v):
    try:
        basestring  # type: ignore[name-defined]
        return isinstance(v, basestring)  # type: ignore[name-defined]
    except NameError:
        return isinstance(v, str)


def _coerce_list6(v):
    if isinstance(v, (list, tuple)) and len(v) == 6:
        try:
            return [float(x) for x in v]
        except Exception:
            return None
    return None


def _coerce_any6(v):
    # Accept list/tuple directly, or parse string "[x,y,z,roll,pitch,yaw]"
    vals = _coerce_list6(v)
    if vals is not None:
        return vals
    if _is_str(v):
        try:
            try:
                arr = json.loads(v)
            except Exception:
                arr = ast.literal_eval(v)
            return _coerce_list6(arr)
        except Exception:
            return None
    return None

pose_vals = None
ros_vals = None
try:
    ros_pose  # type: ignore[name-defined]
    ros_vals = _coerce_any6(ros_pose)  # type: ignore[name-defined]
except NameError:
    pass

try:
    pose  # type: ignore[name-defined]
    pose_vals = _coerce_list6(pose)  # type: ignore[name-defined]
except NameError:
    pass

vals = ros_vals if ros_vals is not None else pose_vals
if rg is not None and vals:
    x_m, y_m, z_m, roll_deg, pitch_deg, yaw_deg = vals
    plane = ros_to_plane(x_m, y_m, z_m, roll_deg, pitch_deg, yaw_deg)
# ---------- end py3 ----------
panel_2 = Panel(movej)
exporter = Python3Script(data=merge_2, file_path="/Users/avery_tsai/project/hiwin_prc/config/cc1122.jsonl", button=Button())  # -> result; inputs data: list of String, file_path: String, button: Boolean
# ---------- exporter: Python ----------
import os

def export_raw(data, file_path):
    """
    將資料原封不動地寫入指定路徑
    data: 任意類型
    file_path: 絕對路徑
    """
    os.makedirs(os.path.dirname(file_path), exist_ok=True)
    with open(file_path, "w", encoding="utf-8") as f:
        f.write(str(data))

def export_jsonl(data, file_path):
    """
    將 list of JSON 字串逐行寫入標準 jsonl 格式
    data: list[str]，每個元素都是 JSON 字串
    file_path: 絕對路徑
    """
    import os
    os.makedirs(os.path.dirname(file_path), exist_ok=True)
    with open(file_path, "w", encoding="utf-8") as f:
        for line in data:
            f.write(line.rstrip("\n") + "\n")

# Grasshopper端：
# 輸入 data (list[str])、file_path (str)、button (bool)
# 直接呼叫 export_jsonl(data, file_path)
if button == True:
    try:
        data  # type: ignore[name-defined]
        file_path  # type: ignore[name-defined]
        export_jsonl(data, file_path)
        result = True
    except Exception as e:
        result = False
        error_msg = str(e)
# ---------- end exporter ----------
pt = Point(py3.plane)
panel_3 = Panel(pt)
panel_4 = Panel(exporter)
